# Dynamo graph 24.03.2026_First_Core_Integration.dyn "23.03.2026_First_Core_Integration" (Dynamo 3.6.1.9895)

# group: Excel_import
file_path = Filename(".\Revit dynamo.xlsx")
code_block = CodeBlock { "ForDynamo"; 0; false; 1; }
openXMLImportExcel = Data.OpenXMLImportExcel(filePath=file_path, sheetName=code_block.out0, startRow=code_block.out1, startColumn=code_block.out1, readAsString=code_block.out2)
local_Y = List.GetItemAtIndex(list=openXMLImportExcel, index=code_block.out3)
local_Y_2 = List.GetItemAtIndex(list=local_Y, index=code_block.out3)
local_X = List.GetItemAtIndex(list=openXMLImportExcel, index=code_block.out1)
local_X_2 = List.GetItemAtIndex(list=local_X, index=code_block.out3)
code_block_2 = CodeBlock(y=local_Y_2, x=local_X_2) { y / 1000; x / 1000; }

# group: Selecting Points
local_x_line = DSModelElementSelection()  # 1 picked in the model
curves = Element.Curves(element=local_x_line)
local_y_line = DSModelElementSelection()  # 1 picked in the model
curves_2 = Element.Curves(element=local_y_line)
intersect_StartPoint = Geometry.Intersect(geometry=curves, other=curves_2)  # "Geometry.Intersect_StartPoint"
X = Point.X(point=intersect_StartPoint)
Y = Point.Y(point=intersect_StartPoint)
start_Point = Point.ByCoordinates(x=X, y=Y)
code_block_3 = CodeBlock { 0.5; }
tangentAtParameter = Curve.TangentAtParameter(curve=curves, param=code_block_3)
normalized_X = Vector.Normalized(vector=tangentAtParameter)  # "Vector.Normalized_X"
code_block_4 = CodeBlock { 0.5; }
tangentAtParameter_2 = Curve.TangentAtParameter(curve=curves_2, param=code_block_4)
normalized_Y = Vector.Normalized(vector=tangentAtParameter_2)  # "Vector.Normalized_Y"

# group: Object1
code_block_5 = CodeBlock { 2; 1; }
file_Path = List.GetItemAtIndex(list=openXMLImportExcel, index=code_block_5.out0)
file_Path_2 = List.GetItemAtIndex(list=file_Path, index=code_block_5.out1)
file_from_path = FileObject(path=file_Path_2)
python_path2family_script = Python(IN[0]=file_from_path)  # CPython3
# ---------- python_path2family_script.python (42 lines) ----------
import clr
import os

clr.AddReference("RevitAPI")
from Autodesk.Revit.DB import *

clr.AddReference("RevitServices")
from RevitServices.Persistence import DocumentManager
from RevitServices.Transactions import TransactionManager

doc = DocumentManager.Instance.CurrentDBDocument

file = IN[0]
path = file.FullName

# family name from file name
family_name = os.path.splitext(os.path.basename(path))[0]

TransactionManager.Instance.EnsureInTransaction(doc)

# load family
doc.LoadFamily(path)

TransactionManager.Instance.TransactionTaskDone()

# find loaded family in project
collector = FilteredElementCollector(doc).OfClass(Family)
family = None

for f in collector:
    if f.Name == family_name:
        family = f
        break

# get first type
symbol = None
if family:
    symbol_ids = family.GetFamilySymbolIds()
    if symbol_ids:
        symbol = doc.GetElement(list(symbol_ids)[0])

OUT = symbol
# ----------------------------------------

# group: Object 2
perpendicular_vector_xy = Python(IN[0]=normalized_X, IN[1]=normalized_Y)  # "perpendicular vector xy normalized x"; CPython3
# ---------- perpendicular_vector_xy.python (41 lines) ----------
import clr
clr.AddReference('ProtoGeometry')
from Autodesk.DesignScript.Geometry import Vector

vs = IN[0]   # main vector or list of vectors
gs = IN[1]   # guide vector or list of vectors

def to_list(x):
    return x if isinstance(x, list) else [x]

vs = to_list(vs)
gs = to_list(gs)

# if one guide vector is given, repeat it for all main vectors
if len(gs) == 1 and len(vs) > 1:
    gs = gs * len(vs)

out = []

for v, g in zip(vs, gs):
    if v is None or g is None:
        out.append(None)
        continue

    x = v.X
    y = v.Y

    # perpendicular in XY
    px = -y
    py = x

    # choose side from guide vector
    dot = px * g.X + py * g.Y

    if dot < 0:
        px = -px
        py = -py

    out.append(Vector.ByCoordinates(px, py, 0))

OUT = out
# ----------------------------------------
code_block_6 = CodeBlock { 3; 1; 5; }
file_Path_3 = List.GetItemAtIndex(list=openXMLImportExcel, index=code_block_6.out2)
file_Path_4 = List.GetItemAtIndex(list=file_Path_3, index=code_block_6.out1)
code_block_7 = CodeBlock { "Lange"; "Breite"; }
lange_Distance = Element.GetParameterValueByName(element=python_path2family_script, parameterName=code_block_7.out0)
code_block_8 = CodeBlock(a=file_Path_4, b=lange_Distance) { (a/1000)+b; }
scale = Vector.Scale(vector=perpendicular_vector_xy, scale_factor=code_block_8)
file_Path_5 = List.GetItemAtIndex(list=openXMLImportExcel, index=code_block_6.out0)
file_Path_6 = List.GetItemAtIndex(list=file_Path_5, index=code_block_6.out1)
file_from_path_2 = FileObject(path=file_Path_6)
python_path2family_script_2 = Python(IN[0]=file_from_path_2)  # CPython3; same code as python_path2family_script

# group: Find_dot
scale_X = Vector.Scale(vector=normalized_X, scale_factor=code_block_2.out1)  # "Vector.Scale_X"
scale_Y = Vector.Scale(vector=perpendicular_vector_xy, scale_factor=code_block_2.out0)  # "Vector.Scale_Y"
add = Vector.Add(vector=scale_X, vectorToAdd=scale_Y)
point_Elenemt1 = Point.Add(point=start_Point, vectorToAdd=add)

# group (continued): Object 2
point_Element2 = Point.Add(point=point_Elenemt1, vectorToAdd=scale)

# group: Correction of placements
breite_Element1_MvSkid = Element.GetParameterValueByName(element=python_path2family_script, parameterName=code_block_7.out1)
breite_Element2_MvSkid = Element.GetParameterValueByName(element=python_path2family_script_2, parameterName=code_block_7.out1)
firstItem = List.FirstItem(list=normalized_X)
alignment_of_objects_in_local_x = Python(IN[0]=point_Elenemt1, IN[1]=point_Element2, IN[2]=breite_Element1_MvSkid, IN[3]=breite_Element2_MvSkid, IN[4]=firstItem)  # "Alignment of objects in Local X acc center"; CPython3
# ---------- alignment_of_objects_in_local_x.python (45 lines) ----------
import clr
clr.AddReference('ProtoGeometry')
from Autodesk.DesignScript.Geometry import Point

def item(x):
    while isinstance(x, list):
        if len(x) == 0:
            return None
        x = x[0]
    return x

def to_num(x):
    x = item(x)
    if isinstance(x, str):
        x = x.strip()
    return float(x)

P1 = item(IN[0])   # Object 1 point
P2 = item(IN[1])   # Object 2 point
b1 = to_num(IN[2]) # Width 1
b2 = to_num(IN[3]) # Width 2
X  = item(IN[4])   # LocalX normalized vector

newP1 = P1
newP2 = P2

if b1 > b2:
    # Object 1 is bigger -> move object 2 in +LocalX
    d = (b1 - b2) / 2.0
    newP2 = Point.ByCoordinates(
        P2.X + X.X * d,
        P2.Y + X.Y * d,
        P2.Z + X.Z * d
    )

elif b2 > b1:
    # Object 2 is bigger -> move object 1 in +LocalX
    d = (b2 - b1) / 2.0
    newP1 = Point.ByCoordinates(
        P1.X + X.X * d,
        P1.Y + X.Y * d,
        P1.Z + X.Z * d
    )

OUT = [newP1, newP2]
# ----------------------------------------
code_block_9 = CodeBlock { 0; 1; }
corrected_obj1_Point = List.GetItemAtIndex(list=alignment_of_objects_in_local_x, index=code_block_9.out0)
corrected_obj2_Point = List.GetItemAtIndex(list=alignment_of_objects_in_local_x, index=code_block_9.out1)
lange_Element2_MvSkid = Element.GetParameterValueByName(element=python_path2family_script_2, parameterName=code_block_7.out0)
lange_Element1_MvSkid = Element.GetParameterValueByName(element=python_path2family_script, parameterName=code_block_7.out0)
alignment_of_objects_in_local_x_2 = Python(IN[0]=start_Point, IN[1]=corrected_obj1_Point, IN[2]=corrected_obj2_Point, IN[3]=normalized_X, IN[4]=normalized_Y, IN[5]=code_block_2.out1, IN[6]=lange_Element2_MvSkid, IN[7]=lange_Element1_MvSkid)  # "Alignment of objects in Local X acc min distance to localY"; CPython3
# ---------- alignment_of_objects_in_local_x_2.python (154 lines) ----------
# Dynamo Python Node
# Inputs: IN[0]=O, IN[1]=P1, IN[2]=P2, IN[3]=X, IN[4]=Y,
#         IN[5]=dMin, IN[6]=L2, IN[7]=L1

import clr
clr.AddReference('ProtoGeometry')
from Autodesk.DesignScript.Geometry import Point, Vector

# ── helpers ───────────────────────────────────────────────────────────────────

def unwrap(val):
    while isinstance(val, (list, tuple)) and len(val) == 1:
        val = val[0]
    return val

def to_xy(obj):
    obj = unwrap(obj)
    if hasattr(obj, 'X') and hasattr(obj, 'Y'):
        return (float(obj.X), float(obj.Y))
    return (float(obj[0]), float(obj[1]))

def norm2(v):
    x, y = v
    mag = (x*x + y*y) ** 0.5
    if mag < 1e-12:
        raise ValueError("Zero-length vector.")
    return (x / mag, y / mag)

def cross2(a, b):
    return a[0]*b[1] - a[1]*b[0]

def dot2(a, b):
    return a[0]*b[0] + a[1]*b[1]

def add2(p, v):
    return (p[0]+v[0], p[1]+v[1])

def scale2(v, s):
    return (v[0]*s, v[1]*s)

def sub2(a, b):
    return (a[0]-b[0], a[1]-b[1])

def to_point(xy, z=0.0):
    return Point.ByCoordinates(xy[0], xy[1], z)

# ── read inputs ───────────────────────────────────────────────────────────────

O_raw  = unwrap(IN[0])
P1_raw = unwrap(IN[1])
P2_raw = unwrap(IN[2])
X_raw  = unwrap(IN[3])
Y_raw  = unwrap(IN[4])
dMin   = float(unwrap(IN[5]))
L2     = float(unwrap(IN[6]))
L1     = float(unwrap(IN[7]))

try:
    z_P1 = float(P1_raw.Z)
    z_P2 = float(P2_raw.Z)
except AttributeError:
    z_P1 = 0.0
    z_P2 = 0.0

O  = to_xy(O_raw)
P1 = to_xy(P1_raw)
P2 = to_xy(P2_raw)

# ── Step 1–2: normalize, compute perp(X) ─────────────────────────────────────

Xhat = norm2(to_xy(X_raw))
Yhat = norm2(to_xy(Y_raw))

perp_ccw = (-Xhat[1],  Xhat[0])
perp_cw  = ( Xhat[1], -Xhat[0])

# ── Step 3: orient perp(X) consistent with Y ─────────────────────────────────

perpX = perp_ccw if dot2(perp_ccw, Yhat) >= 0.0 else perp_cw

# ── Step 4: four object points ────────────────────────────────────────────────

P1_end = add2(P1, scale2(perpX, L1))
P2_end = add2(P2, scale2(perpX, L2))

# ── Step 5: signed perpendicular distances to Y-line through O ───────────────
# s = cross(P - O, Yhat)

def sdist(P):
    return cross2(sub2(P, O), Yhat)

s_P1    = sdist(P1)
s_P1end = sdist(P1_end)
s_P2    = sdist(P2)
s_P2end = sdist(P2_end)

signed_dists = [s_P1, s_P1end, s_P2, s_P2end]

# ── Step 6: translation t along X ────────────────────────────────────────────
#
# Moving P by t*Xhat changes its signed distance by:
#   delta_s = cross(Xhat, Yhat)
#
# VALID SIDE: derived purely from the direction vectors, not from where the
# points currently sit.  The objects live on the side that Xhat "points toward"
# relative to the Y-line.
#
#   delta_s > 0  →  +X increases signed dist  →  valid side is positive (+1)
#   delta_s < 0  →  +X decreases signed dist  →  valid side is negative (-1)
#
# This is unambiguous for any angle between X and Y (acute or obtuse).

delta_s = cross2(Xhat, Yhat)

if abs(delta_s) < 1e-12:
    # X parallel to Y — movement along X cannot change perp distance
    OUT = [P1_raw, P2_raw]
else:
    # Valid side: the sign that moving in +X pushes points toward
    valid_sign = 1 if delta_s > 0 else -1

    # Target signed distance (positive or negative dMin on the valid side)
    target = dMin * valid_sign

    # Required t for each point to reach exactly the target boundary:
    #   s(P) + t * delta_s = target  →  t = (target - s) / delta_s
    t_candidates = [(target - s) / delta_s for s in signed_dists]

    # We need ALL points to be at or beyond dMin on the valid side.
    # The binding constraint is the point requiring the most movement.
    #
    # When valid_sign > 0 (positive side):
    #   We need s_new >= dMin  →  t >= (dMin - s) / delta_s
    #   The largest t_candidate satisfies all constraints simultaneously.
    #
    # When valid_sign < 0 (negative side):
    #   We need s_new <= -dMin  →  t <= (-dMin - s) / delta_s
    #   The smallest (most negative) t_candidate is the binding one.
    #
    # In both cases: pick max if delta_s > 0, min if delta_s < 0.
    # (This is equivalent to: the t that moves the closest point to exactly dMin.)

    if delta_s > 0:
        t = max(t_candidates)
    else:
        t = min(t_candidates)

    # ── Step 7: apply translation ─────────────────────────────────────────────

    shift = scale2(Xhat, t)
    newP1 = to_point(add2(P1, shift), z_P1)
    newP2 = to_point(add2(P2, shift), z_P2)

    OUT = [newP1, newP2]
# ----------------------------------------
corrected_obj1_Point_2 = List.GetItemAtIndex(list=alignment_of_objects_in_local_x_2, index=code_block_9.out0)
corrected_obj2_Point_2 = List.GetItemAtIndex(list=alignment_of_objects_in_local_x_2, index=code_block_9.out1)

# group (continued): Object1
byPoint = FamilyInstance.ByPoint(familyType=python_path2family_script, point=corrected_obj1_Point_2)
python_rotation_script = Python(IN[0]=byPoint, IN[1]=normalized_X)  # CPython3
# ---------- python_rotation_script.python (51 lines) ----------
import clr
import math

clr.AddReference("RevitAPI")
from Autodesk.Revit.DB import *

clr.AddReference("RevitServices")
from RevitServices.Persistence import DocumentManager
from RevitServices.Transactions import TransactionManager

clr.AddReference("RevitNodes")
import Revit
clr.ImportExtensions(Revit.Elements)

doc = DocumentManager.Instance.CurrentDBDocument

def first_item(x):
    while isinstance(x, list):
        if len(x) == 0:
            return None
        x = x[0]
    return x

inst = first_item(IN[0])
xvec = first_item(IN[1])

inst = UnwrapElement(inst)

if inst is None or xvec is None:
    OUT = "Input is empty"
else:
    # build perpendicular vector from LocalX
    # (+90° in XY plane)
    px = -xvec.Y
    py =  xvec.X

    target_angle = math.atan2(py, px)

    facing = inst.FacingOrientation
    current_angle = math.atan2(facing.Y, facing.X)

    delta = target_angle - current_angle

    pt = inst.Location.Point
    axis = Line.CreateBound(pt, XYZ(pt.X, pt.Y, pt.Z + 10))

    TransactionManager.Instance.EnsureInTransaction(doc)
    ElementTransformUtils.RotateElement(doc, inst.Id, axis, delta)
    TransactionManager.Instance.TransactionTaskDone()

    OUT = delta
# ----------------------------------------

# group (continued): Object 2
byPoint_2 = FamilyInstance.ByPoint(familyType=python_path2family_script_2, point=corrected_obj2_Point_2)
python_rotation_script_2 = Python(IN[0]=byPoint_2, IN[1]=normalized_X)  # CPython3; same code as python_rotation_script

# group: Core_Creation
objects = List.Create(item0=byPoint_2, item1=byPoint)  # frozen
code_block_10 = CodeBlock { 4; 6; }  # frozen
distance_in_x_zwitchen_repeat = List.GetItemAtIndex(list=openXMLImportExcel, index=code_block_10.out1)  # frozen
code_block_11 = CodeBlock { 1; }  # frozen
getItemAtIndex = List.GetItemAtIndex(list=distance_in_x_zwitchen_repeat, index=code_block_11)  # frozen
code_block_12 = CodeBlock(x=getItemAtIndex) { x/1000; }  # frozen
breites = List.Create(item0=breite_Element1_MvSkid, item1=breite_Element2_MvSkid)  # frozen
maximumItem = List.MaximumItem(list=breites)  # frozen
code_block_13 = CodeBlock(a=code_block_12, b=maximumItem) { (a+b)/0.3048; }  # frozen
scale_2 = Vector.Scale(vector=normalized_X, scale_factor=code_block_13)  # frozen
amount_of_repeat_in_a_core = List.GetItemAtIndex(list=openXMLImportExcel, index=code_block_10.out0)  # frozen
getItemAtIndex_2 = List.GetItemAtIndex(list=amount_of_repeat_in_a_core, index=code_block_11)  # frozen
python_script = Python(IN[0]=objects, IN[1]=scale_2, IN[2]=getItemAtIndex_2)  # CPython3; frozen
# ---------- python_script.python (41 lines) ----------
import clr
from System.Collections.Generic import List

clr.AddReference('RevitAPI')
from Autodesk.Revit.DB import *

clr.AddReference('RevitServices')
from RevitServices.Persistence import DocumentManager
from RevitServices.Transactions import TransactionManager

doc = DocumentManager.Instance.CurrentDBDocument

elements = UnwrapElement(IN[0])
base_vector = IN[1]
repeat = int(IN[2])

if not isinstance(elements, list):
    elements = [elements]

# if vector comes as [vector], take first item
if isinstance(base_vector, list):
    base_vector = base_vector[0]

copies = repeat - 1
if copies < 0:
    copies = 0

ids = List[ElementId]([e.Id for e in elements])

out = []

TransactionManager.Instance.EnsureInTransaction(doc)

for i in range(1, copies + 1):
    move = XYZ(base_vector.X * i, base_vector.Y * i, base_vector.Z * i)
    newIds = ElementTransformUtils.CopyElements(doc, ids, move)
    out.append([doc.GetElement(x) for x in newIds])

TransactionManager.Instance.TransactionTaskDone()

OUT = out
# ----------------------------------------

# group: Cable_Dots
element2MVs_Cablepoint = Python(IN[0]=corrected_obj2_Point_2, IN[1]=byPoint_2, IN[2]=normalized_X, IN[3]=normalized_Y)  # CPython3
# ---------- element2MVs_Cablepoint.python (83 lines) ----------
import clr
clr.AddReference('ProtoGeometry')
from Autodesk.DesignScript.Geometry import Point, Vector

def first(x):
    while isinstance(x, list) and len(x) == 1:
        x = x[0]
    return x

refPt = first(IN[0])                 # one family base point
elem  = UnwrapElement(first(IN[1]))  # family instance
ux    = first(IN[2])                 # real local X
g     = first(IN[3])                 # guide direction

def get_param(e, name):
    # instance parameter
    p = e.LookupParameter(name)
    if p:
        return p.AsDouble()

    # type parameter
    try:
        t = e.Symbol
        if t:
            p = t.LookupParameter(name)
            if p:
                return p.AsDouble()
    except:
        pass

    return None

def build_local_y(localX, guide):
    py_x = -localX.Y
    py_y =  localX.X
    dot = py_x * guide.X + py_y * guide.Y
    if dot < 0:
        py_x = -py_x
        py_y = -py_y
    return Vector.ByCoordinates(py_x, py_y, 0)

def make_point(basePt, localX, localY, xVal, yVal, zVal):
    move = localX.Scale(xVal).Add(localY.Scale(yVal)).Add(Vector.ByCoordinates(0, 0, 1).Scale(zVal))
    return basePt.Add(move)

# raw values from Revit = feet
x1_raw = get_param(elem, "Cable_X1")
y1_raw = get_param(elem, "Cable_Y1")
z1_raw = get_param(elem, "Cable_Z1")

x2_raw = get_param(elem, "Cable_X2")
y2_raw = get_param(elem, "Cable_Y2")
z2_raw = get_param(elem, "Cable_Z2")

missing = []
for n, v in [("Cable_X1", x1_raw), ("Cable_Y1", y1_raw), ("Cable_Z1", z1_raw),
             ("Cable_X2", x2_raw), ("Cable_Y2", y2_raw), ("Cable_Z2", z2_raw)]:
    if v is None:
        missing.append(n)

ux_len = (ux.X**2 + ux.Y**2) ** 0.5

if ux_len == 0:
    OUT = "Error: local X vector length is zero."
elif missing:
    OUT = "Missing parameters: " + ", ".join(missing)
else:
    # feet -> meters
    x1 = x1_raw * 0.3048
    y1 = y1_raw * 0.3048
    z1 = z1_raw * 0.3048

    x2 = x2_raw * 0.3048
    y2 = y2_raw * 0.3048
    z2 = z2_raw * 0.3048

    localX = Vector.ByCoordinates(ux.X / ux_len, ux.Y / ux_len, 0)
    localY = build_local_y(localX, g)

    pt1 = make_point(refPt, localX, localY, x1, y1, z1)
    pt2 = make_point(refPt, localX, localY, x2, y2, z2)

    OUT = pt1, pt2, [x1, y1, z1], [x2, y2, z2]
# ----------------------------------------
element1_ss__cablepoint = Python(IN[0]=corrected_obj1_Point_2, IN[1]=byPoint, IN[2]=normalized_X, IN[3]=normalized_Y)  # CPython3; same code as element2MVs_Cablepoint
final_Local_Y = Python(IN[0]=start_Point, IN[1]=normalized_X, IN[2]=normalized_Y)  # CPython3
# ---------- final_Local_Y.python (36 lines) ----------
import clr
clr.AddReference('ProtoGeometry')
from Autodesk.DesignScript.Geometry import Point, Vector, CoordinateSystem

def first(x):
    while isinstance(x, list) and len(x) == 1:
        x = x[0]
    return x

origin = first(IN[0])
ux = first(IN[1])
g = first(IN[2])

ux_len = (ux.X**2 + ux.Y**2) ** 0.5

if ux_len == 0:
    OUT = "Error: local X vector length is zero."
else:
    localX = Vector.ByCoordinates(ux.X / ux_len, ux.Y / ux_len, 0)

    # build perpendicular local Y
    yx = -localX.Y
    yy =  localX.X

    # flip with guide direction
    dot = yx * g.X + yy * g.Y
    if dot < 0:
        yx = -yx
        yy = -yy

    localY = Vector.ByCoordinates(yx, yy, 0)
    localZ = Vector.ByCoordinates(0, 0, 1)

    cs = CoordinateSystem.ByOriginVectors(origin, localX, localY)

    OUT = origin, localX, localY, localZ, cs
# ----------------------------------------
code_block_14 = CodeBlock { 2; }
local_Y_3 = List.GetItemAtIndex(list=final_Local_Y, index=code_block_14)
code_block_15 = CodeBlock { "Cable"; 0; false; }
openXMLImportExcel_2 = Data.OpenXMLImportExcel(filePath=file_path, sheetName=code_block_15.out0, startRow=code_block_15.out1, startColumn=code_block_15.out1, readAsString=code_block_15.out2)
code_block_16 = CodeBlock { 7; 3; 8; 0; 9; 10; 11; 6; 1; 2; 4; 12; }
safety_Distance_For_MVs_meeting_point = List.GetItemAtIndex(list=openXMLImportExcel_2, index=code_block_16.out2)
bending_radius = List.GetItemAtIndex(list=openXMLImportExcel_2, index=code_block_16.out1)
height_above_ground = List.GetItemAtIndex(list=openXMLImportExcel_2, index=code_block_16.out3)
MVskid_Meeting_Point = Python(IN[0]=element2MVs_Cablepoint, IN[1]=local_Y_3, IN[2]=safety_Distance_For_MVs_meeting_point, IN[3]=bending_radius, IN[4]=height_above_ground)  # CPython3
# ---------- MVskid_Meeting_Point.python (38 lines) ----------
import clr
clr.AddReference('ProtoGeometry')
from Autodesk.DesignScript.Geometry import Point, Vector

def first(x):
    while isinstance(x, list) and len(x) == 1:
        x = x[0]
    return x

def excel_value(x):
    x = first(x)
    if isinstance(x, list) and len(x) > 1:
        x = x[1]
    try:
        return float(x) / 1000.0
    except:
        return 0.0

data    = first(IN[0])
localY  = first(IN[1])
safe    = excel_value(IN[2])
bend    = excel_value(IN[3])
heightZ = excel_value(IN[4])

p1 = data[0]
p2 = data[1]

mx = (p1.X + p2.X) / 2.0
my = (p1.Y + p2.Y) / 2.0
mz = (p1.Z + p2.Z) / 2.0
mvMid = Point.ByCoordinates(mx, my, mz)

dist = safe + bend
tmpPt = mvMid.Add(localY.Scale(-dist))

mvMeetPt = Point.ByCoordinates(tmpPt.X, tmpPt.Y, heightZ)

OUT = mvMeetPt
# ----------------------------------------
mid_Point_SS = Python(IN[0]=element1_ss__cablepoint)  # CPython3
# ---------- mid_Point_SS.python (21 lines) ----------
import clr
clr.AddReference('ProtoGeometry')
from Autodesk.DesignScript.Geometry import Point

def first(x):
    while isinstance(x, list) and len(x) == 1:
        x = x[0]
    return x

data = first(IN[0])

p1 = data[0]
p2 = data[1]

mx = (p1.X + p2.X) / 2.0
my = (p1.Y + p2.Y) / 2.0
mz = (p1.Z + p2.Z) / 2.0

ssMid = Point.ByCoordinates(mx, my, mz)

OUT = ssMid
# ----------------------------------------
safety_Distance_For_Ss_meeting_point = List.GetItemAtIndex(list=openXMLImportExcel_2, index=code_block_16.out0)
smartstack_Meeting_Point = Python(IN[0]=mid_Point_SS, IN[1]=local_Y_3, IN[2]=safety_Distance_For_Ss_meeting_point, IN[3]=bending_radius, IN[4]=height_above_ground)  # CPython3
# ---------- smartstack_Meeting_Point.python (31 lines) ----------
import clr
clr.AddReference('ProtoGeometry')
from Autodesk.DesignScript.Geometry import Point, Vector

def first(x):
    while isinstance(x, list) and len(x) == 1:
        x = x[0]
    return x

def excel_value(x):
    x = first(x)
    if isinstance(x, list) and len(x) > 1:
        x = x[1]
    try:
        return float(x) / 1000.0
    except:
        return 0.0

ssMid   = first(IN[0])
localY  = first(IN[1])
safe    = excel_value(IN[2])
bend    = excel_value(IN[3])
heightZ = excel_value(IN[4])

dist = safe + bend
move = localY.Scale(dist)

tmpPt = ssMid.Add(move)
ssMeetPt = Point.ByCoordinates(tmpPt.X, tmpPt.Y, heightZ)

OUT = ssMeetPt
# ----------------------------------------
mv_start_straight_length = List.GetItemAtIndex(list=openXMLImportExcel_2, index=code_block_16.out5)
ss_start_straight_length = List.GetItemAtIndex(list=openXMLImportExcel_2, index=code_block_16.out6)
file_Path_7 = List.GetItemAtIndex(list=openXMLImportExcel_2, index=code_block_16.out7)
file_Path_8 = List.GetItemAtIndex(list=file_Path_7, index=code_block_16.out8)
file_from_path_3 = FileObject(path=file_Path_8)
python_path2family_script_3 = Python(IN[0]=file_from_path_3)  # CPython3; same code as python_path2family_script
breite_Rod = Element.GetParameterValueByName(element=python_path2family_script_3, parameterName=code_block_7.out1)
diameter = List.GetItemAtIndex(list=openXMLImportExcel_2, index=code_block_16.out9)
safety_distance_zwitchen_rods = List.GetItemAtIndex(list=openXMLImportExcel_2, index=code_block_16.out4)
clearence = List.GetItemAtIndex(list=openXMLImportExcel_2, index=code_block_16.out10)
draw_2_MAINLINEs = Python(IN[0]=element2MVs_Cablepoint, IN[1]=element1_ss__cablepoint, IN[2]=MVskid_Meeting_Point, IN[3]=smartstack_Meeting_Point, IN[4]=normalized_X, IN[5]=local_Y_3, IN[6]=mv_start_straight_length, IN[7]=ss_start_straight_length, IN[8]=breite_Rod, IN[9]=diameter, IN[10]=safety_distance_zwitchen_rods, IN[11]=clearence)  # CPython3
# ---------- draw_2_MAINLINEs.python (189 lines) ----------
import clr
clr.AddReference('ProtoGeometry')
from Autodesk.DesignScript.Geometry import Point, Line, Vector
import math

def unwrap(x):
    while isinstance(x, (list, tuple)) and len(x) == 1:
        x = x[0]
    return x

def to_pt(x):
    x = unwrap(x)
    if hasattr(x, 'X'):
        return x
    return Point.ByCoordinates(float(x[0]), float(x[1]), float(x[2]) if len(x) > 2 else 0.0)

def to_vec(x):
    x = unwrap(x)
    if hasattr(x, 'X'):
        return x
    return Vector.ByCoordinates(float(x[0]), float(x[1]), float(x[2]) if len(x) > 2 else 0.0)

def norm_xy(v):
    l = (v.X**2 + v.Y**2) ** 0.5
    if l < 1e-10:
        return Vector.ByCoordinates(1, 0, 0)
    return Vector.ByCoordinates(v.X/l, v.Y/l, 0)

def from_excel(x, idx=1):
    """Read value from Excel list at index, convert mm to m."""
    x = unwrap(x)
    if isinstance(x, (list, tuple)):
        x = x[idx] if len(x) > idx else x[0]
    try:
        return float(x) / 1000.0
    except:
        return 0.0

def move(pt, vec, dist):
    return Point.ByCoordinates(
        pt.X + vec.X * dist,
        pt.Y + vec.Y * dist,
        pt.Z + vec.Z * dist
    )

def safe_line(a, b, tol=1e-6):
    if abs(a.X-b.X) < tol and abs(a.Y-b.Y) < tol and abs(a.Z-b.Z) < tol:
        return None
    try:
        return Line.ByStartPointEndPoint(a, b)
    except:
        return None

# ── Inputs ────────────────────────────────────────────────────────────────────
# IN[0]  = [mv1, mv2]          MV exit points
# IN[1]  = [ss1, ss2]          SS entry points
# IN[2]  = mvMeet              center meeting point MV side
# IN[3]  = ssMeet              center meeting point SS side
# IN[4]  = localX vector
# IN[5]  = localY vector
# IN[6]  = [label, mvLen_mm]   straight exit length MV
# IN[7]  = [label, ssLen_mm]   straight exit length SS
# IN[8]  = [label, rodBreite_mm]
# IN[9]  = [label, cableDia_mm]
# IN[10] = [label, extraAbstand_mm]

mvPts = unwrap(IN[0])
ssPts = unwrap(IN[1])
mv1   = to_pt(mvPts[0])
mv2   = to_pt(mvPts[1])
ss1   = to_pt(ssPts[0])
ss2   = to_pt(ssPts[1])

mvMeet = to_pt(unwrap(IN[2]))
ssMeet = to_pt(unwrap(IN[3]))

localX = norm_xy(to_vec(unwrap(IN[4])))
localY = norm_xy(to_vec(unwrap(IN[5])))

mvLen        = abs(from_excel(IN[6],  idx=1))
ssLen        = abs(from_excel(IN[7],  idx=1))
rodBreite    = abs(from_excel(IN[8],  idx=1))
cableDia     = abs(from_excel(IN[9],  idx=1))
extraAbstand = abs(from_excel(IN[10], idx=1))

# ── Abstand calculation ───────────────────────────────────────────────────────
# o°o trefoil: horizontal footprint = 2 × cableDia per system
sysBreite = 2.0 * cableDia

# rod/2 + sysBreite + extraAbstand + sysBreite + rod/2
abstand = rodBreite/2.0 + sysBreite + extraAbstand + sysBreite + rodBreite/2.0
half    = abstand / 2.0

# ── Column X positions left/right of center ───────────────────────────────────
# Route 1 = left  (-half in localX)
# Route 2 = right (+half in localX)

# At mvMeet level — T2 points, Z snapped to mvMeet.Z
mv_r1 = Point.ByCoordinates(
    mvMeet.X + localX.X * -half,
    mvMeet.Y + localX.Y * -half,
    mvMeet.Z                        # Z from mvMeet
)
mv_r2 = Point.ByCoordinates(
    mvMeet.X + localX.X *  half,
    mvMeet.Y + localX.Y *  half,
    mvMeet.Z                        # Z from mvMeet
)

# At ssMeet level — T3 points, Z snapped to ssMeet.Z
ss_r1 = Point.ByCoordinates(
    ssMeet.X + localX.X * -half,
    ssMeet.Y + localX.Y * -half,
    ssMeet.Z                        # Z from ssMeet
)
ss_r2 = Point.ByCoordinates(
    ssMeet.X + localX.X *  half,
    ssMeet.Y + localX.Y *  half,
    ssMeet.Z                        # Z from ssMeet
)

# ── Route 1 turn points ───────────────────────────────────────────────────────
# T1: mv1 straight out in -localY by mvLen
r1_T1 = move(mv1, localY, -mvLen)

# T2: same Y/Z as T1, X snapped to route-1 column (mv_r1.X)
r1_T2 = Point.ByCoordinates(mv_r1.X, mv_r1.Y, mvMeet.Z)

# T3: route-1 column at ssMeet level (already computed as ss_r1)
r1_T3 = ss_r1

# T4: ss1 exits +localX by ssLen → ssStart1 is ssLen out from ss1
ssStart1 = move(ss1, localX, ssLen)
# T4 is at ssStart1 X, but at ssMeet Z level
r1_T4 = Point.ByCoordinates(ssStart1.X, ss_r1.Y, ssMeet.Z)

# ── Route 2 turn points ───────────────────────────────────────────────────────
# T1: mv2 straight out in -localY by mvLen
r2_T1 = move(mv2, localY, -mvLen)

# T2: X snapped to route-2 column (mv_r2), Z from mvMeet
r2_T2 = Point.ByCoordinates(mv_r2.X, mv_r2.Y, mvMeet.Z)

# T3: route-2 column at ssMeet level
r2_T3 = ss_r2

# T4: ss2 exits -localX by ssLen
ssStart2 = move(ss2, localX, -ssLen)
r2_T4 = Point.ByCoordinates(ssStart2.X, ss_r2.Y, ssMeet.Z)

# ── Build segments ────────────────────────────────────────────────────────────
def make_route(mvPt, T1, T2, T3, T4, ssStart, ssPt):
    segs = [
        safe_line(mvPt,    T1),       # exit MV in -localY (mvLen)
        safe_line(T1,      T2),       # lateral ±localX to column
        safe_line(T2,      T3),       # down through both meet levels
        safe_line(T3,      T4),       # lateral ±localX toward SS
        safe_line(T4,      ssStart),  # down to SS entry level
        safe_line(ssStart, ssPt),     # ssLen into SS entry point
    ]
    return [s for s in segs if s is not None]

r1 = make_route(mv1, r1_T1, r1_T2, r1_T3, r1_T4, ssStart1, ss1)
r2 = make_route(mv2, r2_T1, r2_T2, r2_T3, r2_T4, ssStart2, ss2)

# ── Output ────────────────────────────────────────────────────────────────────
# r1_T2, r1_T3, r2_T2, r2_T3 are already computed above
# groundZ taken from ssMeet (the lower meeting point)
groundZ = ssMeet.Z
OUT = (
    r1, r2, abstand,
    r1_T2, r1_T3,
    r2_T2, r2_T3,
    localX, localY,
    groundZ,
    cableDia,
    rodBreite,
    ssMeet.Z,       # temporary debug — what number shows here?
)

#OUT = (
#    r1, r2, abstand,    # [0] [1] [2]
#    r1_T2, r1_T3,       # [3] [4]
#    r2_T2, r2_T3,       # [5] [6]
#    localX, localY,     # [7] [8]
#    groundZ,            # [9]
#    cableDia,           # [10]
#    rodBreite,          # [11]
#)
# ----------------------------------------
repead_rod_spacing = List.GetItemAtIndex(list=openXMLImportExcel_2, index=code_block_16.out11)
cableCountSystem = List.GetItemAtIndex(list=openXMLImportExcel_2, index=code_block_16.out8)

creating_all_lines_for_each_trefoil = Python(IN[0]=draw_2_MAINLINEs, IN[1]=python_path2family_script_3, IN[2]=repead_rod_spacing, IN[3]=cableCountSystem, IN[4]=bending_radius, IN[5]=clearence)  # CPython3
# ---------- creating_all_lines_for_each_trefoil.python (481 lines) ----------
import clr
import math
clr.AddReference('ProtoGeometry')
import Autodesk.DesignScript.Geometry as DSGeo
clr.AddReference("RevitAPI")
from Autodesk.Revit.DB import *
clr.AddReference("RevitServices")
from RevitServices.Persistence import DocumentManager
from RevitServices.Transactions import TransactionManager

doc = DocumentManager.Instance.CurrentDBDocument

def unwrap(x):
    while isinstance(x, (list, tuple)) and len(x) == 1:
        x = x[0]
    return x

def to_int_idx(x, idx=1):
    x = unwrap(x)
    if isinstance(x, (list, tuple)):
        x = x[idx] if len(x) > idx else x[0]
    try:
        return int(float(x))
    except:
        return 0

def from_excel(x, idx=1):
    x = unwrap(x)
    if isinstance(x, (list, tuple)):
        x = x[idx] if len(x) > idx else x[0]
    try:
        return float(x) / 1000.0
    except:
        return 0.0

def to_pt(x):
    x = unwrap(x)
    if hasattr(x, 'X'):
        return x
    return DSGeo.Point.ByCoordinates(
        float(x[0]), float(x[1]),
        float(x[2]) if len(x) > 2 else 0.0
    )

def to_vec(x):
    x = unwrap(x)
    if hasattr(x, 'X'):
        return x
    return DSGeo.Vector.ByCoordinates(float(x[0]), float(x[1]), 0.0)

def norm_xy(v):
    l = (v.X**2 + v.Y**2) ** 0.5
    if l < 1e-10:
        return DSGeo.Vector.ByCoordinates(1, 0, 0)
    return DSGeo.Vector.ByCoordinates(v.X/l, v.Y/l, 0)

def dist_pt(a, b):
    return math.sqrt((a.X-b.X)**2 + (a.Y-b.Y)**2)

def dist_3d(a, b):
    return math.sqrt((a.X-b.X)**2+(a.Y-b.Y)**2+(a.Z-b.Z)**2)

def m_to_ft(m):
    return m / 0.3048

def mkpt(x, y, z):
    return DSGeo.Point.ByCoordinates(x, y, z)

def proj(pt_a, pt_b, vec):
    return (pt_b.X-pt_a.X)*vec.X + (pt_b.Y-pt_a.Y)*vec.Y

# ── Inputs ────────────────────────────────────────────────────────────────────
routing      = IN[0]
symbol       = unwrap(IN[1])
rodSpacing_m = abs(from_excel(IN[2], idx=1))
numSystems   = to_int_idx(IN[3], idx=1)
bendRadius_m = abs(from_excel(IN[4], idx=1))
clearance_m  = abs(from_excel(IN[5], idx=1))

t2_r1        = to_pt(routing[3])
t3_r1        = to_pt(routing[4])
t2_r2        = to_pt(routing[5])
t3_r2        = to_pt(routing[6])
localX       = norm_xy(to_vec(routing[7]))
localY       = norm_xy(to_vec(routing[8]))
groundZ_m    = float(routing[9])
cableDia_m   = float(routing[10])
rodBreite_m  = float(routing[11])

r1_lines     = routing[0]
r2_lines     = routing[1]

def line_start(l):
    return to_pt(l.StartPoint)

def line_end(l):
    return to_pt(l.EndPoint)

mv1   = line_start(r1_lines[0])
r1_T1 = line_end(r1_lines[0])
r1_T2 = line_end(r1_lines[1])
r1_T3 = line_end(r1_lines[2])
r1_T4 = line_end(r1_lines[3])
ss1   = line_end(r1_lines[-1])

mv2   = line_start(r2_lines[0])
r2_T1 = line_end(r2_lines[0])
r2_T2 = line_end(r2_lines[1])
r2_T3 = line_end(r2_lines[2])
r2_T4 = line_end(r2_lines[3])
ss2   = line_end(r2_lines[-1])

# ssLen: straight exit length on SS side
# = distance from ss1 to ssStart (line[-2] end = line[-1] start)
ssStart1  = line_start(r1_lines[-1])
ssStart2  = line_start(r2_lines[-1])
ssLen_r1  = dist_pt(ss1, ssStart1)
ssLen_r2  = dist_pt(ss2, ssStart2)

# mvLen: straight exit length on MV side
mvStart1  = line_end(r1_lines[0])   # = T1
mvLen_r1  = dist_pt(mv1, mvStart1)
mvLen_r2  = dist_pt(mv2, line_end(r2_lines[0]))

# ── Rod height ────────────────────────────────────────────────────────────────
sin60         = math.sqrt(3) / 2.0
rowStep_m     = cableDia_m * (1.0 + sin60) + clearance_m
numRows       = int(math.ceil(numSystems / 2.0))
lastRow       = numRows - 1

topCableTop_m = (groundZ_m
    + cableDia_m / 2.0
    + lastRow * rowStep_m
    + cableDia_m * sin60
    + cableDia_m / 2.0)

rodHeight_m   = topCableTop_m - groundZ_m

# ── Rod positions ─────────────────────────────────────────────────────────────

def get_rod_positions(t2, t3):
    segLen = dist_pt(t2, t3)
    if segLen < 1e-6:
        return []

    start_offset = min(2.0 * bendRadius_m, segLen * 0.4)
    end_offset   = min(1.0 * bendRadius_m, segLen * 0.4)
    start_ratio  = start_offset / segLen
    end_ratio    = 1.0 - (end_offset / segLen)

    p_start = mkpt(
        t2.X + (t3.X - t2.X) * start_ratio,
        t2.Y + (t3.Y - t2.Y) * start_ratio,
        groundZ_m
    )
    p_end = mkpt(
        t2.X + (t3.X - t2.X) * end_ratio,
        t2.Y + (t3.Y - t2.Y) * end_ratio,
        groundZ_m
    )

    seg = dist_pt(p_start, p_end)
    if seg < 1e-6:
        return [p_start]

    n_intervals = int(math.ceil(seg / rodSpacing_m)) if rodSpacing_m > 1e-6 else 1

    positions = []
    for i in range(n_intervals + 1):
        t = i / float(n_intervals)
        positions.append(mkpt(
            p_start.X + (p_end.X - p_start.X) * t,
            p_start.Y + (p_end.Y - p_start.Y) * t,
            groundZ_m
        ))
    return positions

rod_pos_r1 = get_rod_positions(t2_r1, t3_r1)
rod_pos_r2 = get_rod_positions(t2_r2, t3_r2)

# ── System offsets on rod ─────────────────────────────────────────────────────
sysBreite_m = 2.0 * cableDia_m
sysOffset_m = rodBreite_m / 2.0 + cableDia_m

def get_system_offsets():
    offsets   = []
    remaining = numSystems
    row       = 0
    while remaining > 0:
        z = groundZ_m + cableDia_m / 2.0 + row * rowStep_m
        if remaining >= 2:
            offsets.append((-sysOffset_m, z))
            offsets.append(( sysOffset_m, z))
            remaining -= 2
        else:
            offsets.append((0.0, z))
            remaining -= 1
        row += 1
    return offsets

sys_offsets = get_system_offsets()

# ── Face connection grids ─────────────────────────────────────────────────────
numCols     = max(1, int(math.ceil(math.sqrt(numSystems))))
numRowsFace = int(math.ceil(numSystems / float(numCols)))
faceSpacing = cableDia_m + clearance_m
gridW       = (numCols - 1) * faceSpacing
gridH       = (numRowsFace - 1) * faceSpacing

def get_face_pts(origin, spread_vec, num):
    pts        = []
    col        = 0
    row        = 0
    col_offset = -gridW / 2.0
    row_offset = -gridH / 2.0
    for i in range(num):
        horiz = col_offset + col * faceSpacing
        vert  = row_offset + row * faceSpacing
        pt = mkpt(
            origin.X + spread_vec.X * horiz,
            origin.Y + spread_vec.Y * horiz,
            origin.Z + vert
        )
        pts.append(pt)
        col += 1
        if col >= numCols:
            col = 0
            row += 1
    return pts

mv_conn_r1 = get_face_pts(mv1, localX, numSystems)
ss_conn_r1 = get_face_pts(ss1, localY, numSystems)
mv_conn_r2 = get_face_pts(mv2, localX, numSystems)
ss_conn_r2 = get_face_pts(ss2, localY, numSystems)

# ── Build path control points ─────────────────────────────────────────────────
# MV exit: -localY by mvLen, then lateral in localX to column
# SS entry: +localX (r1) or -localX (r2) by ssLen from ss_conn,
#           then lateral in localY to match column, then into ss_conn
# This way each ss_conn has its OWN approach segment — no convergence

def build_path(mv_conn, ss_conn, x_off, sys_z,
               T1, T2, T3, T4,
               rod_positions,
               mv_len, ss_len, ss_exit_sign):
    """
    ss_exit_sign: +1 for r1 (exits +localX), -1 for r2 (exits -localX)
    """
    pts = []

    # A: MV connection
    A = mv_conn
    pts.append(A)

    # B: exit MV in -localY by mvLen (same for all systems, from their conn pt)
    B = mkpt(
        A.X + localY.X * (-mv_len),
        A.Y + localY.Y * (-mv_len),
        A.Z
    )
    pts.append(B)

    # C: lateral to sys column at T1 level, keep A.Z
    C = mkpt(T1.X + localX.X * x_off,
             T1.Y + localX.Y * x_off,
             A.Z)
    pts.append(C)

    # D: T2 column, still at conn Z
    D = mkpt(T2.X + localX.X * x_off,
             T2.Y + localX.Y * x_off,
             A.Z)
    pts.append(D)

    # E: drop to rod height
    E = mkpt(D.X, D.Y, sys_z)
    pts.append(E)

    # rod intermediate points
    for rod_pt in rod_positions:
        pts.append(mkpt(
            rod_pt.X + localX.X * x_off,
            rod_pt.Y + localX.Y * x_off,
            sys_z
        ))

    # F: T3 column at sys_z
    F = mkpt(T3.X + localX.X * x_off,
             T3.Y + localX.Y * x_off,
             sys_z)
    pts.append(F)

    # G: rise to ss_conn.Z at T3 column
    G = mkpt(F.X, F.Y, ss_conn.Z)
    pts.append(G)

    # H: lateral in localY to match ss_conn localY position
    # move from G to ss_conn's localY coordinate
    d_y = proj(G, ss_conn, localY)
    H = mkpt(
        G.X + localY.X * d_y,
        G.Y + localY.Y * d_y,
        ss_conn.Z
    )
    pts.append(H)

    # I: ss_conn moved outward by ssLen in exit direction
    # this is the point ssLen away from ss face in exit direction
    I = mkpt(
        ss_conn.X + localX.X * ss_exit_sign * ss_len,
        ss_conn.Y + localX.Y * ss_exit_sign * ss_len,
        ss_conn.Z
    )
    pts.append(I)

    # J: SS connection
    pts.append(ss_conn)

    return pts

def make_nurbs(ctrl_pts):
    clean = [ctrl_pts[0]]
    for p in ctrl_pts[1:]:
        prev = clean[-1]
        if dist_3d(p, prev) > 1e-4:
            clean.append(p)
    if len(clean) < 2:
        return None
    try:
        deg = min(3, len(clean) - 1)
        return DSGeo.NurbsCurve.ByControlPoints(clean, deg)
    except:
        return None

# ── Build curves ──────────────────────────────────────────────────────────────
sys_curves_r1 = []
sys_curves_r2 = []
debug_errors  = []

for i, (x_off, z) in enumerate(sys_offsets):
    try:
        ctrl1 = build_path(
            mv_conn_r1[i], ss_conn_r1[i],
            x_off, z,
            r1_T1, r1_T2, r1_T3, r1_T4,
            rod_pos_r1,
            mvLen_r1, ssLen_r1, +1
        )
        c1 = make_nurbs(ctrl1)
        sys_curves_r1.append(c1)
        if not c1:
            debug_errors.append("r1 sys{} nurbs failed, {} pts".format(i, len(ctrl1)))
    except Exception as e:
        sys_curves_r1.append(None)
        debug_errors.append("r1 sys{} error: {}".format(i, str(e)))

    try:
        ctrl2 = build_path(
            mv_conn_r2[i], ss_conn_r2[i],
            x_off, z,
            r2_T1, r2_T2, r2_T3, r2_T4,
            rod_pos_r2,
            mvLen_r2, ssLen_r2, -1
        )
        c2 = make_nurbs(ctrl2)
        sys_curves_r2.append(c2)
        if not c2:
            debug_errors.append("r2 sys{} nurbs failed, {} pts".format(i, len(ctrl2)))
    except Exception as e:
        sys_curves_r2.append(None)
        debug_errors.append("r2 sys{} error: {}".format(i, str(e)))

# ── Place rods ────────────────────────────────────────────────────────────────

def place_rods(positions, sym, height_m):
    placed = []
    if hasattr(sym, 'InternalElement'):
        sym = sym.InternalElement
    angle = math.atan2(localX.Y, localX.X)

    TransactionManager.Instance.EnsureInTransaction(doc)
    if not sym.IsActive:
        sym.Activate()
        doc.Regenerate()
    TransactionManager.Instance.TransactionTaskDone()

    TransactionManager.Instance.EnsureInTransaction(doc)
    for pt in positions:
        revit_pt = XYZ(m_to_ft(pt.X), m_to_ft(pt.Y), m_to_ft(groundZ_m))
        inst = doc.Create.NewFamilyInstance(
            revit_pt, sym,
            Structure.StructuralType.NonStructural
        )
        loc = inst.Location
        if hasattr(loc, 'Point'):
            current_z = loc.Point.Z
            target_z  = m_to_ft(groundZ_m)
            if abs(current_z - target_z) > 1e-6:
                loc.Move(XYZ(0, 0, target_z - current_z))

        for pname in ["Offset", "Höhenversatz", "Elevation", "Höhe von Ebene"]:
            p = inst.LookupParameter(pname)
            if p and not p.IsReadOnly and p.StorageType == StorageType.Double:
                p.Set(0.0)
                break

        if abs(angle) > 1e-6:
            placed_z = inst.Location.Point.Z
            axis = Line.CreateBound(
                XYZ(revit_pt.X, revit_pt.Y, placed_z),
                XYZ(revit_pt.X, revit_pt.Y, placed_z + 1)
            )
            ElementTransformUtils.RotateElement(doc, inst.Id, axis, angle)

        for pname in ["Hoehe", "Höhe", "Height", "Laenge", "Länge", "Length"]:
            p = inst.LookupParameter(pname)
            if p and not p.IsReadOnly:
                p.Set(m_to_ft(height_m))
                break
        placed.append(inst)
    TransactionManager.Instance.TransactionTaskDone()
    return placed

placed_r1 = place_rods(rod_pos_r1, symbol, rodHeight_m)
placed_r2 = place_rods(rod_pos_r2, symbol, rodHeight_m)

# ── System group points ───────────────────────────────────────────────────────

def all_system_pts(rod_positions):
    all_pts = []
    for rodPt in rod_positions:
        row_pts = []
        for (x_off, z) in sys_offsets:
            pt = mkpt(
                rodPt.X + localX.X * x_off,
                rodPt.Y + localX.Y * x_off,
                z
            )
            row_pts.append(pt)
        all_pts.append(row_pts)
    return all_pts

sys_pts_r1 = all_system_pts(rod_pos_r1)
sys_pts_r2 = all_system_pts(rod_pos_r2)

# ── Output ────────────────────────────────────────────────────────────────────
OUT = (
    placed_r1,
    placed_r2,
    sys_curves_r1,
    sys_curves_r2,
    sys_pts_r1,
    sys_pts_r2,
    mv_conn_r1,
    ss_conn_r1,
    mv_conn_r2,
    ss_conn_r2,
    debug_errors,
    {
        "numSystems":    numSystems,
        "numCurves_r1":  len([c for c in sys_curves_r1 if c]),
        "numCurves_r2":  len([c for c in sys_curves_r2 if c]),
        "numRods_r1":    len(rod_pos_r1),
        "numRods_r2":    len(rod_pos_r2),
        "numErrors":     len(debug_errors),
        "rodHeight_m":   round(rodHeight_m,  4),
        "sysOffset_m":   round(sysOffset_m,  4),
        "rowStep_m":     round(rowStep_m,    4),
        "faceSpacing_m": round(faceSpacing,  4),
        "ssLen_r1":      round(ssLen_r1,     4),
        "ssLen_r2":      round(ssLen_r2,     4),
        "mvLen_r1":      round(mvLen_r1,     4),
        "rodSpacing_m":  round(rodSpacing_m, 4),
        "bendRadius_m":  round(bendRadius_m, 4),
        "clearance_m":   round(clearance_m,  4),
        "groundZ_m":     round(groundZ_m,    4),
        "cableDia_m":    round(cableDia_m,   4),
        "gridW_m":       round(gridW,        4),
        "gridH_m":       round(gridH,        4),
    }
)
# ----------------------------------------
trefoil_sweep = Python(IN[0]=creating_all_lines_for_each_trefoil)  # CPython3
# ---------- trefoil_sweep.python (164 lines) ----------
import clr
import math
clr.AddReference('ProtoGeometry')
import Autodesk.DesignScript.Geometry as DSGeo

def unwrap(x):
    while isinstance(x, (list, tuple)) and len(x) == 1:
        x = x[0]
    return x

prev          = IN[0]
sys_curves_r1 = prev[2]
sys_curves_r2 = prev[3]
info_dict     = prev[11]
cableDia_m    = float(info_dict["cableDia_m"])

sin60  = math.sqrt(3) / 2.0
r      = cableDia_m / 2.0
half_d = cableDia_m / 2.0

trefoil_offsets = [
    (-half_d, 0.0              ),
    ( half_d, 0.0              ),
    ( 0.0,    cableDia_m*sin60 ),
]

def get_right_vec(curves):
    for c in curves:
        if c is None:
            continue
        try:
            tan = c.TangentAtParameter(0.5)
            tan_h = DSGeo.Vector.ByCoordinates(tan.X, tan.Y, 0)
            if tan_h.Length > 0.01:
                tan_h = tan_h.Normalized()
                world_z = DSGeo.Vector.ByCoordinates(0, 0, 1)
                rv = world_z.Cross(tan_h).Normalized()
                if rv.Length > 0.01:
                    return rv
        except:
            continue
    return DSGeo.Vector.ByCoordinates(1, 0, 0)

def try_sweep(profile, path):
    """Try multiple sweep methods, return first that works."""
    # method 1: direct BySweep
    try:
        s = DSGeo.Solid.BySweep(profile, path)
        if s is not None:
            return s, "BySweep"
    except:
        pass

    # method 2: convert curve to polycurve first
    try:
        pts = [path.PointAtParameter(i/20.0) for i in range(21)]
        # build lines between consecutive points
        lines = []
        for i in range(len(pts)-1):
            try:
                l = DSGeo.Line.ByStartPointEndPoint(pts[i], pts[i+1])
                lines.append(l)
            except:
                pass
        if lines:
            pc = DSGeo.PolyCurve.ByJoinedCurves(lines)
            s = DSGeo.Solid.BySweep(profile, pc)
            if s is not None:
                return s, "BySweep+PolyCurve"
    except:
        pass

    # method 3: pipe (cylinder along path)
    try:
        s = DSGeo.Solid.BySweep(profile, path, False)
        if s is not None:
            return s, "BySweep+open"
    except:
        pass

    return None, "all_failed"

def make_trefoil_sweep(curve, right_vec):
    errors = []
    trio   = []
    up_vec = DSGeo.Vector.ByCoordinates(0, 0, 1)

    try:
        start_pt = curve.StartPoint
        tan      = curve.TangentAtParameter(
                       curve.ParameterAtPoint(start_pt))
        tan_vec  = DSGeo.Vector.ByCoordinates(
                       tan.X, tan.Y, tan.Z).Normalized()

        for (h, v) in trefoil_offsets:
            center = DSGeo.Point.ByCoordinates(
                start_pt.X + right_vec.X * h + up_vec.X * v,
                start_pt.Y + right_vec.Y * h + up_vec.Y * v,
                start_pt.Z + right_vec.Z * h + up_vec.Z * v
            )
            try:
                circle = DSGeo.Circle.ByCenterPointRadiusNormal(
                    center, r, tan_vec
                )
                solid, method = try_sweep(circle, curve)
                trio.append(solid)
                if solid is None:
                    errors.append("all methods failed h={:.3f} v={:.3f}".format(h, v))
            except Exception as e:
                errors.append("circle/sweep error: {}".format(str(e)))
                trio.append(None)

    except Exception as e:
        errors.append("setup fail: {}".format(str(e)))
        trio = [None, None, None]

    return trio, errors

# ── Run sweeps ────────────────────────────────────────────────────────────────
all_errors = []
sweeps_r1  = []
sweeps_r2  = []

right_vec_r1 = get_right_vec(sys_curves_r1)
right_vec_r2 = get_right_vec(sys_curves_r2)

for curve in sys_curves_r1:
    if curve is not None:
        trio, errs = make_trefoil_sweep(curve, right_vec_r1)
        sweeps_r1.append(trio)
        all_errors.extend(errs)
    else:
        sweeps_r1.append([None, None, None])

for curve in sys_curves_r2:
    if curve is not None:
        trio, errs = make_trefoil_sweep(curve, right_vec_r2)
        sweeps_r2.append(trio)
        all_errors.extend(errs)
    else:
        sweeps_r2.append([None, None, None])

flat_r1 = [s for trio in sweeps_r1 for s in trio if s is not None]
flat_r2 = [s for trio in sweeps_r2 for s in trio if s is not None]

OUT = (
    flat_r1,
    flat_r2,
    sweeps_r1,
    sweeps_r2,
    all_errors,
    {
        "numSweeps_r1":  len(sweeps_r1),
        "numSweeps_r2":  len(sweeps_r2),
        "numSolids_r1":  len(flat_r1),
        "numSolids_r2":  len(flat_r2),
        "numErrors":     len(all_errors),
        "cableDia_m":    round(cableDia_m, 4),
        "r_m":           round(r,          4),
        "right_vec_r1":  [round(right_vec_r1.X,3),
                          round(right_vec_r1.Y,3),
                          round(right_vec_r1.Z,3)],
    }
)
# ----------------------------------------
